# Grasshopper definition spiral_cup.gh (Grasshopper 1.0.7)

bump_height = Slider(4, range=0..10)
bump_width = Slider(10, range=5..20)
radius = Slider(30, range=0..100)
offset = Slider(15, range=0..100)
python = GhPythonScript()  # -> out, file
# ---------- python: Python ----------
import rhinoscriptsyntax as rs
#Create a new file
filter = "GCode (*.gcode)|*.gcode|All Files (*.*)|*.*||"
file = rs.SaveFileName("", filter)
# ---------- end python ----------
list = ValueList({"Square", "Triangle", "Loop"}, selected="Triangle")
panel = Panel(python.file)
python_2 = GhPythonScript(
    filename=python.file,
    radius=radius,
    layer_height=Slider(50, range=0..1000),
    offset=offset,
    bump_width=bump_width,
    bump_height=bump_height,
    shape_type=list)  # -> out, lines, turtle; inputs radius: Int32, layer_height: Int32, offset: Int32, bump_width: Int32, bump_height: Int32
# ---------- python_2: Python ----------
import rhinoscriptsyntax as rs
import sys
import math
import operator as op
import extruder_turtle
from extruder_turtle import *
from spiral_cup import SpiralCup   # file

to_delete = list()
for module in sys.modules:
    if "spiral_cup" in module:
      to_delete.append(module)
for module in to_delete:
    sys.modules.pop(module)
    
t = ExtruderTurtle()
t.setup(x=0, y=0, z=0, filename=filename, printer = "eazao")
t.set_extrude_rate(0.8) 
t.set_extrude_width(1.5) 
extrude_width = t.get_extrude_width()
print(t.get_speed())
    
s = SpiralCup(t)
s.bump(layer_height, radius, bump_height, bump_width, offset, shape_type)

lines = t.get_lines()
t.finish()
# ---------- end python_2 ----------
